# Dynamo graph DriveThru-Parametric site.dyn (Dynamo 2.0.2.6826)

# group: Site Corners
number_slider = DoubleSlider(0, range=0..100 step 0.1)
number_slider_2 = DoubleSlider(0, range=0..100 step 0.1)
byCoordinates = Point.ByCoordinates(x=number_slider, y=number_slider_2)
number_slider_3 = DoubleSlider(0, range=0..100 step 0.1)
number_slider_4 = DoubleSlider(30, range=0..100 step 0.1)
byCoordinates_2 = Point.ByCoordinates(x=number_slider_3, y=number_slider_4)
number_slider_5 = DoubleSlider(20, range=0..100 step 0.1)
number_slider_6 = DoubleSlider(30, range=0..100 step 0.1)
byCoordinates_3 = Point.ByCoordinates(x=number_slider_5, y=number_slider_6)
number_slider_7 = DoubleSlider(20, range=0..100 step 0.1)
number_slider_8 = DoubleSlider(0, range=-0.905..100 step 0.1)
byCoordinates_4 = Point.ByCoordinates(x=number_slider_7, y=number_slider_8)
number_slider_9 = DoubleSlider(0, range=0..100 step 0.1)
number_slider_10 = DoubleSlider(0, range=0..100 step 0.1)
number_slider_11 = DoubleSlider(1, range=0..100 step 0.1)
number_slider_12 = DoubleSlider(1, range=0..100 step 0.1)

list_create = List.Create(item0=byCoordinates, item1=byCoordinates_2, item2=byCoordinates_3, item3=byCoordinates_4)
byPoints = Polygon.ByPoints(points=list_create)
byStartPointEndPoint = Line.ByStartPointEndPoint(startPoint=byCoordinates_4, endPoint=byCoordinates)

# group: Lane to site distance X
lane_to_site_distance_x = DoubleSlider(1, range=1..7 step 0.5)  # graph input

parameterAtSegmentLength = Curve.ParameterAtSegmentLength(curve=byStartPointEndPoint, segmentLength=lane_to_site_distance_x)
pointAtParameter = Curve.PointAtParameter(curve=byStartPointEndPoint, param=parameterAtSegmentLength)
byStartPointEndPoint_2 = Line.ByStartPointEndPoint(startPoint=byCoordinates_2, endPoint=byCoordinates)

# group: Lane to site distance Y
lane_to_site_distance_y = DoubleSlider(2.5, range=1..4 step 0.5)  # graph input

parameterAtSegmentLength_2 = Curve.ParameterAtSegmentLength(curve=byStartPointEndPoint_2, segmentLength=lane_to_site_distance_y)
pointAtParameter_2 = Curve.PointAtParameter(curve=byStartPointEndPoint_2, param=parameterAtSegmentLength_2)
byStartPointEndPoint_3 = Line.ByStartPointEndPoint(startPoint=byCoordinates_3, endPoint=byCoordinates_4)
byTwoPoints = Vector.ByTwoPoints(start=byCoordinates_2, end=byCoordinates_3)
project = Point.Project(point=pointAtParameter_2, baseGeometry=byStartPointEndPoint_3, projectionDirection=byTwoPoints)
byStartPointEndPoint_4 = Line.ByStartPointEndPoint(startPoint=pointAtParameter_2, endPoint=project)
byStartPointEndPoint_5 = Line.ByStartPointEndPoint(startPoint=byCoordinates_2, endPoint=byCoordinates_3)
byTwoPoints_2 = Vector.ByTwoPoints(start=byCoordinates_4, end=byCoordinates_3)
project_2 = Point.Project(point=pointAtParameter, baseGeometry=byStartPointEndPoint_5, projectionDirection=byTwoPoints_2)
byStartPointEndPoint_6 = Line.ByStartPointEndPoint(startPoint=pointAtParameter, endPoint=project_2)
intersect = Geometry.Intersect(geometry=byStartPointEndPoint_4, other=byStartPointEndPoint_6)
byStartPointEndPoint_7 = Line.ByStartPointEndPoint(startPoint=pointAtParameter, endPoint=intersect)
byStartPointEndPoint_8 = Line.ByStartPointEndPoint(startPoint=pointAtParameter_2, endPoint=intersect)
integer_slider = IntegerSlider(6, range=1..20 step 1)
byFillet = Arc.ByFillet(curve1=byStartPointEndPoint_7, curve2=byStartPointEndPoint_8, radius=integer_slider)
reverse = Curve.Reverse(curve=byFillet)

# group: Lane Width
lane_width = DoubleSlider(3, range=2.5..4 step 0.5)  # graph input

# group: Lane to Building distance X
lane_to_building_distance_x = DoubleSlider(1, range=0.5..4 step 0.5)  # graph input

code_block = CodeBlock(i=lane_to_site_distance_x, laneWidth=lane_width, offset=lane_to_building_distance_x) { i+laneWidth+offset; }
parameterAtSegmentLength_3 = Curve.ParameterAtSegmentLength(curve=byStartPointEndPoint, segmentLength=code_block)
pointAtParameter_3 = Curve.PointAtParameter(curve=byStartPointEndPoint, param=parameterAtSegmentLength_3)

# group: Lane to building distance Y
lane_to_building_distance_y = DoubleSlider(0.5, range=0.5..4 step 0.5)  # graph input

code_block_2 = CodeBlock(i=lane_to_site_distance_y, laneWidth=lane_width, offset=lane_to_building_distance_y) { i+laneWidth+offset; }
parameterAtSegmentLength_4 = Curve.ParameterAtSegmentLength(curve=byStartPointEndPoint_2, segmentLength=code_block_2)
pointAtParameter_4 = Curve.PointAtParameter(curve=byStartPointEndPoint_2, param=parameterAtSegmentLength_4)
byTwoPoints_3 = Vector.ByTwoPoints(start=byCoordinates_2, end=byCoordinates_3)
project_3 = Point.Project(point=pointAtParameter_4, baseGeometry=byStartPointEndPoint_3, projectionDirection=byTwoPoints_3)
byStartPointEndPoint_9 = Line.ByStartPointEndPoint(startPoint=pointAtParameter_4, endPoint=project_3)
byTwoPoints_4 = Vector.ByTwoPoints(start=byCoordinates_4, end=byCoordinates_3)
project_4 = Point.Project(point=pointAtParameter_3, baseGeometry=byStartPointEndPoint_5, projectionDirection=byTwoPoints_4)
byStartPointEndPoint_10 = Line.ByStartPointEndPoint(startPoint=pointAtParameter_3, endPoint=project_4)
intersect_2 = Geometry.Intersect(geometry=byStartPointEndPoint_9, other=byStartPointEndPoint_10)
byStartPointEndPoint_11 = Line.ByStartPointEndPoint(startPoint=pointAtParameter_3, endPoint=intersect_2)  # frozen
byStartPointEndPoint_12 = Line.ByStartPointEndPoint(startPoint=pointAtParameter_4, endPoint=intersect_2)  # frozen
integer_slider_2 = IntegerSlider(6, range=1..20 step 1)
byFillet_2 = Arc.ByFillet(curve1=byStartPointEndPoint_11, curve2=byStartPointEndPoint_12, radius=integer_slider_2)
reverse_2 = Curve.Reverse(curve=byFillet_2)
intersect_3 = Geometry.Intersect(geometry=byStartPointEndPoint_12, other=byFillet_2)
byStartPointEndPoint_13 = Line.ByStartPointEndPoint(startPoint=pointAtParameter_4, endPoint=intersect_3)
intersect_4 = Geometry.Intersect(geometry=byStartPointEndPoint_11, other=byFillet_2)
byStartPointEndPoint_14 = Line.ByStartPointEndPoint(startPoint=intersect_4, endPoint=pointAtParameter_3)
flatten = List.Flatten(list=byStartPointEndPoint_14)
list_create_2 = List.Create(item0=byStartPointEndPoint_13, item1=byFillet_2, item2=flatten)

# group: Building Inside Corner
building_inside_corner_x = DoubleSlider(9.598, range=1..12 step 0.5)  # graph input
building_inside_corner_y = DoubleSlider(15.978, range=1..20 step 0.5)  # graph input
byCoordinates_5 = Point.ByCoordinates(x=building_inside_corner_x, y=building_inside_corner_y)

closestPointTo = Geometry.ClosestPointTo(geometry=byStartPointEndPoint_9, other=byCoordinates_5)
closestPointTo_2 = Geometry.ClosestPointTo(geometry=byStartPointEndPoint_10, other=byCoordinates_5)
list_create_3 = List.Create(item0=byCoordinates, item1=pointAtParameter_4, item2=closestPointTo, item3=byCoordinates_5, item4=closestPointTo_2, item5=pointAtParameter_3)
flatten_2 = List.Flatten(list=list_create_3)
byPoints_2 = Polygon.ByPoints(points=flatten_2)
code_block_3 = CodeBlock { 4; }
extrudeAsSolid = Curve.ExtrudeAsSolid(curve=byPoints_2, distance=code_block_3)
code_block_4 = CodeBlock { 100; }
code_block_5 = CodeBlock { 250; }
byARGB = Color.ByARGB(g=code_block_4, b=code_block_5)
byGeometryColor = Modifiers.GeometryColor.ByGeometryColor(geometry=extrudeAsSolid, color=byARGB)
byPerimeterPoints = Surface.ByPerimeterPoints(points=flatten_2)
byGeometryColor_2 = Modifiers.GeometryColor.ByGeometryColor(geometry=byPerimeterPoints, color=byARGB)
byPerimeterPoints_2 = Surface.ByPerimeterPoints(points=list_create)
code_block_6 = CodeBlock { -0.1; }
translate = Geometry.Translate(geometry=byPerimeterPoints_2, zTranslation=code_block_6)
code_block_7 = CodeBlock { 200; }
byARGB_2 = Color.ByARGB(g=code_block_7)
byGeometryColor_3 = Modifiers.GeometryColor.ByGeometryColor(geometry=translate, color=byARGB_2)
building_area = Surface.Area(surface=byPerimeterPoints)  # graph output
intersect_5 = Geometry.Intersect(geometry=byStartPointEndPoint_8, other=byFillet)
byStartPointEndPoint_15 = Line.ByStartPointEndPoint(startPoint=pointAtParameter_2, endPoint=intersect_5)
intersect_6 = Geometry.Intersect(geometry=byStartPointEndPoint_7, other=byFillet)
byStartPointEndPoint_16 = Line.ByStartPointEndPoint(startPoint=intersect_6, endPoint=pointAtParameter)
flatten_3 = List.Flatten(list=byStartPointEndPoint_16)
list_create_4 = List.Create(item0=byStartPointEndPoint_15, item1=byFillet, item2=flatten_3)
flatten_4 = List.Flatten(list=list_create_4)
byJoinedCurves = PolyCurve.ByJoinedCurves(curves=flatten_4)
code_block_8 = CodeBlock(number=lane_width) { -number; }
boolean = BoolSelector(true)
offset = PolyCurve.Offset(polyCurve=byJoinedCurves, signedDistance=code_block_8, extendCircular=boolean)
list_create_5 = List.Create(item0=byJoinedCurves, item1=offset)
byLoft = Surface.ByLoft(crossSections=list_create_5)
lane_area = Surface.Area(surface=byLoft)
byTwoPoints_5 = Vector.ByTwoPoints(start=byCoordinates_5, end=closestPointTo)
length = Vector.Length(vector=byTwoPoints_5)
byTwoPoints_6 = Vector.ByTwoPoints(start=byCoordinates_5, end=closestPointTo_2)
length_2 = Vector.Length(vector=byTwoPoints_6)
add = length + length_2
sum_of_sides_on_building_corner = Watch(add)  # graph output
site_area = Surface.Area(surface=byPerimeterPoints_2)
code_block_9 = CodeBlock(siteArea=site_area)
# ---------- code_block_9.designscript (4 lines) ----------
//[$/m2]
rentperarea=8;
//[$]
totalrent=rentperarea * siteArea;
# ----------------------------------------
rent = Watch(code_block_9.totalrent)  # graph output
